# Grasshopper definition Energy_and_Daylight_Model_from_gbXML.gh (Grasshopper 0.9.76)
# plug-ins: Python Interpreter

ladybug = Ladybug_Ladybug()  # -> Vviiiiiiiiiizzz; plug-in component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
honeybee = Honeybee_Honeybee()  # -> Vviiiiiiiiiizzz; plug-in component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

# ----
# Set this to the
# gbXML file path
path = FilePath("C:\Users\chris\Google Drive\LadybugTools\Example Files\Honeybee Examples\SampleGBXMLfromRevit.xml")

# ----
# Parameters for the Energy Simulation
panel = Panel("https://www.energyplus.net/weather-download/north_and_central_america_wmo_region_4/USA/NY/USA_NY_New.York-J.F.Kennedy.Intl.AP.744860_TMY3/all")
energysimpar = Honeybee_EnergySimulationPar(timestep=6, solarDistribution="1")  # -> energySimPar; plug-in component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
analysisperiod = Ladybug_AnalysisPeriod(fromMonth="12", toMonth="12")  # -> readMe, analysisPeriod; plug-in component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
epw_stat = Ladybug_OpenEPWAndSTATWeatherFiles(weatherFileURL=panel)  # -> epwFile, statFile; plug-in component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

# ----
# Import the gbXML
# to HBZones
toggle = BooleanToggle(False)

file_path_to_gbxml = Panel(path)
xmltohb = Honeybee_gbXMLToHoneybee(filepath=file_path_to_gbxml, import=toggle)  # -> readMe, model, HBZones, shadings; plug-in component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

edges = BrepEdges(Brep=[xmltohb.HBZones, xmltohb.shadings])  # -> Naked, Interior, NonManifold

# ----
# Parameters for the Daylight Simulation
panel_2 = Panel("12")
genhbzonetestpts = Honeybee_GenerateZoneTestPoints(HBZone=xmltohb.HBZones, gridSize="0.5", distBaseSrf="0.8", moveTestMesh=True)  # -> readMe, simplify(testPoints), simplify(ptsVectors), simplify(facesArea), simplify(mesh); plug-in component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
genstandardciesky = Honeybee_GenerateStandardCIESky(weatherFile=epw_stat.epwFile, month=panel_2, day="21", hour="12", skyType="4")  # -> skyFilePath; plug-in component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
gridbasedsimulation = Honeybee_GridBasedSimulation(skyFile=genstandardciesky, testPoints=genhbzonetestpts.testPoints, simulationType=0)  # -> analysisRecipe; plug-in component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

# ----
# Run the Energy
# Model
toggle_2 = BooleanToggle(False)
# Run the Daylight
# Model
toggle_3 = BooleanToggle(False)
# If you edit the
# HBzones, export
# them to an
# updated gbXML
toggle_4 = BooleanToggle(False)
exporttoopenstudio = Honeybee_ExportToOpenStudio(
    epwWeatherFile=epw_stat.epwFile,
    analysisPeriod=analysisperiod.analysisPeriod,
    energySimPar=energysimpar,
    HBZones=flatten(xmltohb.HBZones),
    HBContext=flatten(xmltohb.shadings),
    writeOSM=toggle_2,
    runSimulation=toggle_2)  # -> readMe, osmFileAddress, idfFileAddress, resultFileAddress, eioFileAddress, rddFileAddress, htmlReport, studyFolder, model; plug-in component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

file_path_to_write_updated_gbxml = Panel("C:\Users\chris\Google Drive\LadybugTools\Example Files\Honeybee Examples\editedModel.xml")
openstudiotoxml = Honeybee_OpenStudioToGbXML(model=exporttoopenstudio.model, filepath=file_path_to_write_updated_gbxml, export=toggle_4)  # -> readMe, success; plug-in component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

rundaylightanalysis = Honeybee_RunDaylightSimulation(
    HBObjects=flatten([xmltohb.HBZones, xmltohb.shadings]),
    analysisRecipe=gridbasedsimulation,
    writeRad=toggle_3,
    runRad=toggle_3,
    numOfCPUs="4",
    overwriteResults=True)  # -> readMe, analysisType, resultsUnit, results, testPts, resultFiles, radGeoFile, studyFolder, done; plug-in component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

# ----
# VisualizeDaylight Model Results
panel_3 = Panel("0")
legendpar = Ladybug_LegendParameters(lowBound=panel_3, highBound="2000", decimalPlaces="0")  # -> legendPar; plug-in component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
mjoin = MeshJoin(Meshes=flatten(genhbzonetestpts.mesh))
recolormesh = Ladybug_RecolorMesh(
    analysisResult=flatten(rundaylightanalysis.results),
    inputMesh=mjoin,
    legendPar=legendpar,
    analysisTitle="Illuminance",
    legendTitle="lux")  # -> readMe, newMesh, newLegend, legendBasePt, meshColors, legendColors; plug-in component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

# ----
# Visualize Zone Geometry
decomposebytype = Honeybee_DecomposeBasedOnType(HBZone=xmltohb.HBZones)  # -> walls, interiorWalls, airWalls, windows, interiorWindows, skylights, roofs, ceilings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; plug-in component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
preview = CustomPreview(
    Geometry=flatten([decomposebytype.windows, decomposebytype.interiorWindows]),
    Shader=ColourSwatch(SwatchColor=RGBA(156, 242, 255, 147)))
preview_2 = CustomPreview(Geometry=xmltohb.shadings, Shader=ColourSwatch(SwatchColor=RGB(189, 189, 189)))
preview_3 = CustomPreview(Geometry=decomposebytype.walls, Shader=ColourSwatch(SwatchColor=RGB(209, 185, 125)))
preview_4 = CustomPreview(Geometry=[decomposebytype.ceilings, decomposebytype.roofs], Shader=ColourSwatch(SwatchColor=RGB(173, 173, 173)))
preview_5 = CustomPreview(Geometry=[decomposebytype.exposedFloors, decomposebytype.floors], Shader=ColourSwatch(SwatchColor=RGB(138, 99, 99)))

# ----
# Visualize Energy Model Results
readepresult = Honeybee_ReadEPResult(resultFileAddress=exporttoopenstudio.resultFileAddress)  # -> totalThermalLoad, thermalLoadBalance, cooling, heating, electricLight, electricEquip, fanElectric, pumpElectric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; plug-in component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
legendpar_2 = Ladybug_LegendParameters(lowBound="0", highBound="20", decimalPlaces="0")  # -> legendPar; plug-in component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
colorzones = Honeybee_ColorZonesByEPResult(zoneData=readepresult.heating, HBZones=flatten(xmltohb.HBZones), legendPar=legendpar_2, runIt=Toggle(True))  # -> readMe, zoneColoredMesh, zoneWireFrame, legend, legendBasePt, analysisTitle, zoneBreps, zoneColors, zoneValues, relevantZoneData; plug-in component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
geo = Geometry([colorzones.legend, colorzones.analysisTitle])
preview_6 = CustomPreview(Geometry=colorzones.zoneBreps, Shader=colorzones.zoneColors)
